# Grasshopper definition tower_radiance_ladybug.gh (Grasshopper 1.0.7)

number_slider = Slider(10, range=0..10)
plane_surface = PlaneSurface(Plane=PlaneXY(0, 0, 0), XSize=number_slider, YSize=number_slider)
deconstruct_brep = DeconstructBrep(Brep=plane_surface)  # -> Faces, Edges, Vertices
line = Line(deconstruct_brep.Edges)
list_item = ListItem(List=line, Index="0", Wrap=True)
list_item_2 = ListItem(List=line, Index="2", Wrap=True)
point_on_curve = PointOnCurve(list_item, parameter=0.5)
point_on_curve_2 = PointOnCurve(list_item_2, parameter=0)
point_on_curve_3 = PointOnCurve(list_item_2, parameter=1)
line_2 = Line(StartPoint=point_on_curve, EndPoint=point_on_curve_2)
line_3 = Line(StartPoint=point_on_curve_2, EndPoint=point_on_curve_3)
line_4 = Line(StartPoint=point_on_curve_3, EndPoint=point_on_curve)
boundary_surfaces = BoundarySurfaces(Edges=[line_3, line_2, line_4])
deconstruct_brep_2 = DeconstructBrep(Brep=boundary_surfaces)  # -> Faces, Edges, Vertices
number_slider_2 = Slider(0.565, range=0..1)
number_slider_3 = Slider(0.565, range=0..1)
number_slider_4 = Slider(0.565, range=0..1)
list_item_3 = ListItem(List=deconstruct_brep_2.Edges, Index="0", Wrap=True)
list_item_4 = ListItem(List=deconstruct_brep_2.Edges, Index="1", Wrap=True)
list_item_5 = ListItem(List=deconstruct_brep_2.Edges, Index="2", Wrap=True)
area = Area(Geometry=boundary_surfaces)  # -> Area, Centroid
curvature = Curvature(Curve=reparameterize(list_item_5), Parameter=Slider(0.403, range=0..1))  # -> Point, Curvature, Curvature_2
curvature_2 = Curvature(Curve=reparameterize(list_item_3), Parameter=number_slider_4)  # -> Point, Curvature, Curvature_2
curvature_3 = Curvature(Curve=reparameterize(list_item_4), Parameter=number_slider_2)  # -> Point, Curvature, Curvature_2
interpolate = Interpolate(
    Vertices=flatten([curvature_2.Point, curvature_3.Point, curvature.Point, area.Centroid]),
    Degree=Slider(3, range=0..10),
    Periodic=Toggle(True),
    KnotStyle=1)  # -> Curve, Length, Domain

number_slider_5 = Slider(25, range=10..40)
series = Series(Start=Slider(0, range=0..10), Step=Slider(1.4, range=0..10), Count=number_slider_5)
unit_z = UnitZ(Factor=series)
move = Move(Geometry=interpolate.Curve, Motion=unit_z)  # -> Geometry, Transform
area_2 = Area(Geometry=move.Geometry)  # -> Area, Centroid
series_2 = Series(Start=Slider(3, range=0..10), Step=Slider(13, range=1..30), Count=number_slider_5)
rotate = Rotate(Geometry=move.Geometry, Angle=degrees(series_2), Plane=area_2.Centroid)  # -> Geometry, Transform
list_item_6 = ListItem(List=rotate.Geometry, Index="0", Wrap=True)
list_item_7 = ListItem(List=rotate.Geometry, Index="-1", Wrap=True)
loft = Loft(Curves=rotate.Geometry, Options={Adjust=False, Closed=False, LoftEnds=0, LoftSimp=0, LoftType=0, Rebuild=10, Refit=0.01})
boundary_surfaces_2 = BoundarySurfaces(Edges=[list_item_7, list_item_6])
brep_join = BrepJoin(Breps=flatten([loft, boundary_surfaces_2]))  # -> Breps, Closed
settings_custom = SettingsCustom(
    StitchSeams=True,
    SimplePlanes=False,
    Refine=True,
    MinCount=Slider(52, range=0..100),
    MaxCount=Slider(100, range=0..100),
    AspectRatio=20,
    MaxDistance=0,
    MaxAngle=20,
    MinEdge=0,
    MaxEdge=0)
mesh_brep = MeshBrep(Brep=brep_join.Breps, Settings=settings_custom)

panel = Panel("https://www.energyplus.net/weather-download/asia_wmo_region_2/CHN//CHN_Guangxi.Zhuang.Nanning.594310_CSWD/all")
epwmap = LBEPWmap(epw_map=Toggle(True))  # -> Output; plug-in component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
downloadepw = LBDownloadWeather(weather_URL=panel)  # -> epw_file, stat_file, ddy_file; plug-in component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
importepw = LBImportEPW(epw_file=downloadepw.epw_file)  # -> location, dry_bulb_temperature, dew_point_temperature, relative_humidity, wind_speed, wind_direction, direct_normal_rad, diffuse_horizontal_rad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; plug-in component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
analysisperiod = LBAnalysisPeriod(
    start_month=Slider(5, range=1..12),
    start_day=Slider(16, range=1..30),
    start_hour=Slider(16, range=1..24),
    end_month=Slider(10, range=1..12),
    end_day=Slider(26, range=1..30),
    end_hour=Slider(19, range=1..24))  # -> period, hoys, dates; plug-in component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
skymatrix = LBCumulativeSkyMatrix(
    location=importepw.location,
    direct_rad=importepw.wind_direction,
    diffuse_rad=importepw.diffuse_horizontal_rad,
    hoys=analysisperiod.hoys)  # -> out, sky_mtx; plug-in component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
incidentradiation = LBIncidentRadiation(
    sky_mtx=skymatrix.sky_mtx,
    geometry=flatten(mesh_brep),
    grid_size=Slider(4, range=0..10),
    offset_dist=Slider(1, range=0..1),
    parallel=Toggle(False),
    run=Toggle(True))  # -> out, points, results, total, mesh, legend, title, int_mtx; plug-in component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

mass_addition = MassAddition(Input=incidentradiation.total)  # -> Result, PartialResults
galapagos = Galapagos(fitness=mass_addition, gene=[number_slider_3, number_slider_2, number_slider_4])
