# Grasshopper definition tower_sunhours_ladybug.gh (Grasshopper 1.0.7)

number_slider = Slider(3, range=0..10)
number_slider_2 = Slider(64, range=0..64)
number_slider_3 = Slider(0.1, range=0..1)
center_box = CenterBox(Base=PlaneXY(0, 0, 0), X=number_slider, Y=number_slider, Z=number_slider)
series = Series(Start="0", Step=number_slider_3, Count=number_slider_2)
vector_xyz = VectorXYZ(XComponent=Slider(26, range=0..50), YComponent=0, ZComponent=0)  # -> Vector, Length
number_slider_4 = Slider(5, range=0..10)
pi = Pi(Factor=series)
series_2 = Series(Start="0", Step=Slider(3, range=0..10), Count=number_slider_2)
box_array = BoxArray(Geometry=center_box, Cell=center_box, XCount=number_slider_4, YCount=number_slider_4, ZCount=Slider(32, range=0..50))  # -> Geometry, Transform
unit_z = UnitZ(Factor=series_2)
bounding_box = BoundingBox(Content=box_array.Geometry, Plane=PlaneXY(0, 0, 0), UnionBox=True)  # -> Box, Box_2
deconstruct_brep = DeconstructBrep(Brep=bounding_box.Box)  # -> Faces, Edges, Vertices
list_item = ListItem(List=deconstruct_brep.Faces, Index=Slider(4, range=0..5), Wrap=True)
area = Area(Geometry=list_item)  # -> Area, Centroid
line = Line(StartPoint=area.Centroid, EndPoint=vector_xyz.Vector)
rotate = Rotate(Geometry=line, Angle=pi, Plane=area.Centroid)  # -> Geometry, Transform
move = Move(Geometry=rotate.Geometry, Motion=unit_z)  # -> Geometry, Transform
end_points = EndPoints(Curve=move.Geometry)  # -> Start, End
point = Point(end_points.End)
interpolate = Interpolate(Vertices=point, Degree=3, Periodic=False, KnotStyle=1)  # -> Curve, Length, Domain
pipe = Pipe(Curve=interpolate.Curve, Radius=Slider(7, range=0..10), Caps=0)
volume = Volume(Geometry=box_array.Geometry)  # -> Volume, Centroid
cap_holes = CapHoles(Brep=pipe)
point_in_brep = PointInBrep(Brep=cap_holes, Point=volume.Centroid, Strict=False)
dispatch = Dispatch(List=box_array.Geometry, DispatchPattern=point_in_brep)  # -> ListA, ListB
box = Box(dispatch.ListB)

multiplication = Multiplication(A=Slider(50, range=0..50), B=Slider(6, range=0..50))
multiplication_2 = Multiplication(A=Slider(21, range=0..50), B=Slider(6, range=0..50))
rectangle = Rectangle(Plane=PlaneXY(0, 0, 0), XSize=multiplication, YSize=multiplication, Radius=0)  # -> Rectangle, Length
negative = Negative(Value=multiplication_2)
vector_xyz_2 = VectorXYZ(XComponent=negative, YComponent=negative, ZComponent=0)  # -> Vector, Length
boundary_surfaces = BoundarySurfaces(Edges=rectangle.Rectangle)
vector_2pt = Vector2Pt(PointA="0,0,0", PointB=vector_xyz_2.Vector, Unitize=False)  # -> Vector, Length
move_2 = Move(Geometry=boundary_surfaces, Motion=vector_2pt.Vector)  # -> Geometry, Transform

epwmap = LBEPWmap(epw_map=Toggle(True))  # -> Output; plug-in component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
panel = Panel("http://climate.onebuilding.org/WMO_Region_5_Southwest_Pacific/SGP_Singapore/SGP_SG_Paya.Lebar.AB.486940_TMYx.zip")
downloadepw = LBDownloadWeather(weather_URL=panel)  # -> epw_file, stat_file, ddy_file; plug-in component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
importepw = LBImportEPW(epw_file=downloadepw.epw_file)  # -> location, dry_bulb_temperature, dew_point_temperature, relative_humidity, wind_speed, wind_direction, direct_normal_rad, diffuse_horizontal_rad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; plug-in component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
division = Division(A=Slider(0.01, range=0..1), B=Slider(2, range=0..10))
analysisperiod = LBAnalysisPeriod(
    start_month=Slider(6, range=0..12),
    start_day=Slider(14, range=0..30),
    start_hour=Slider(7, range=0..24),
    end_month=Slider(12, range=0..12),
    end_day=Slider(26, range=0..30),
    end_hour=Slider(15, range=0..24))  # -> period, hoys, dates; plug-in component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
sunpath = LBSunPath(location=importepw.location, hoys=analysisperiod.hoys, scale=division)  # -> out, vectors, altitudes, azimuths, hoys, sun_pts, analemma, daily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; plug-in component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
geometry = Geometry(box)
directsunhours = LBDirectSunHours(
    vectors=flatten(sunpath.vectors),
    geometry=flatten(geometry),
    context=flatten(move_2.Geometry),
    grid_size=Slider(3, range=0..10),
    offset_dist=Slider(1, range=0..10),
    parallel=Toggle(False),
    run=Toggle(False))  # -> out, points, results, mesh, legend, title, int_mtx; plug-in component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

mass_addition = MassAddition(Input=directsunhours.results)  # -> Result, PartialResults
galapagos = Galapagos(fitness=mass_addition, gene=[number_slider_3, number_slider_2])
