# Grasshopper definition tower_veiw_ladybug.gh (Grasshopper 1.0.7)

# ----
# Variables
twist_degree = Slider(19, range=0..30)
floor_to_floor_angle = Slider(50, range=0..90)
x_movement = Slider(-3, range=-5..5)
unit_x = UnitX(Factor=x_movement)
radians = Radians(Degrees=floor_to_floor_angle)

series = Series(Start=0, Step=Slider(7, range=0..10), Count=Slider(10, range=0..10))
vector_xyz = VectorXYZ(XComponent=0, YComponent=0, ZComponent=series)  # -> Vector, Length
curve = Curve(<curve referenced from the Rhino model>)
boundary_surfaces = BoundarySurfaces(Edges=curve)
number_slider = Slider(0.1, range=0.1..12.1)
number_slider_2 = Slider(12.1, range=0.1..12.1)
panel = Panel("2 to -2")
construct_domain = ConstructDomain(DomainStart=number_slider, DomainEnd=number_slider_2)
galapagos = Galapagos(fitness=mass_addition, gene=[x_movement, twist_degree, floor_to_floor_angle])

# ----
# Surrounding towers
number_slider_3 = Slider(21, range=0..30)
number_slider_4 = Slider(10, range=0..10)
vector_xyz_2 = VectorXYZ(XComponent=Slider(-100, range=-100..20), YComponent=Slider(-100, range=-100..20), ZComponent=0)  # -> Vector, Length
number_slider_5 = Slider(7, range=0..10)
square = Square(Plane=PlaneXY(0, 0, 0), Size=number_slider_3, ExtentX=number_slider_4, ExtentY=number_slider_4)  # -> Cells, Points
move = Move(Geometry=square.Points, Motion=vector_xyz_2.Vector)  # -> Geometry, Transform
construct_domain_2 = ConstructDomain(DomainStart=Slider(16, range=0..60), DomainEnd=Slider(60, range=0..60))
construct_domain_3 = ConstructDomain(DomainStart=Slider(21, range=0..60), DomainEnd=Slider(52, range=0..60))
rectangle = Rectangle(Plane=move.Geometry, XSize=number_slider_5, YSize=number_slider_5, Radius=0)  # -> flatten(Rectangle), Length
list_length = ListLength(List=rectangle.Rectangle)
random = Random(Range=construct_domain_2, Number=list_length, Seed=Slider(4, range=0..10))  # -> flatten(Random)
random_2 = Random(Range=construct_domain_3, Number=list_length, Seed=Slider(9, range=0..10))  # -> flatten(Random)
area = Area(Geometry=rectangle.Rectangle)  # -> Area, Centroid
sort_list = SortList(Keys=rectangle.Rectangle, ValuesA=random)  # -> Keys, ValuesA
sort_list_2 = SortList(Keys=rectangle.Rectangle, ValuesValuesA=random_2)  # -> Keys, ValuesValuesA
height = Data(sort_list.ValuesA)
multiplication = Multiplication(A=Slider(0.02, range=0..0.2), B=sort_list_2.ValuesValuesA)
scale = Scale(Geometry=rectangle.Rectangle, Center=area.Centroid, Factor=multiplication)  # -> Geometry, Transform

# ----
# Core
panel_2 = Panel("-1")
number_slider_6 = Slider(2, range=0..10)

# ----
# Ellipse
number_slider_7 = Slider(8, range=0..10)

# ----
# Rotation & Movement
list_length_2 = ListLength(List=vector_xyz.Vector)
move_2 = Move(Geometry=vector_xyz.Vector, Motion=unit_x)  # -> Geometry, Transform
rotate_plane = RotatePlane(Plane=move_2.Geometry, Angle=radians)
series_2 = Series(Start=0, Step=twist_degree, Count=list_length_2)
radians_2 = Radians(Degrees=series_2)

list_item = ListItem(List=rotate_plane, Index=panel_2, Wrap=True)
list_item_2 = ListItem(List=rotate_plane, Index="0", Wrap=True)
circle = Circle(Plane=list_item_2, Radius=number_slider_6)
circle_2 = Circle(Plane=list_item, Radius=number_slider_6)
loft = Loft(
    Curves=[circle_2, circle],
    Options={Adjust=False, Closed=False, LoftEnds=0, LoftSimp=0, LoftType=0, Rebuild=10, Refit=0.01})

ellipse = Ellipse(Plane=rotate_plane, Radius1=Slider(4, range=0..10), Radius2=number_slider_7)  # -> Ellipse, Focus1, Focus2
boundary_surfaces_2 = BoundarySurfaces(Edges=ellipse.Ellipse)

rotate = Rotate(Geometry=boundary_surfaces_2, Angle=radians_2, Plane=move_2.Geometry)  # -> Geometry, Transform

list_item_3 = ListItem(List=rotate.Geometry, Index="0", Wrap=True)
list_item_4 = ListItem(List=rotate.Geometry, Index="-1", Wrap=True)
loft_2 = Loft(Curves=rotate.Geometry, Options={Adjust=False, Closed=False, LoftEnds=0, LoftSimp=0, LoftType=0, Rebuild=10, Refit=0.01})
surface = Surface([list_item_3, list_item_4])
brep_join = BrepJoin(Breps=[loft_2, loft, rotate.Geometry])  # -> Breps, Closed

# ----
# Tower selection within the boundary
area_2 = Area(Geometry=rotate_plane)  # -> Area, Centroid
area_3 = Area(Geometry=rectangle.Rectangle)  # -> Area, Centroid
list_item_5 = ListItem(List=area_2.Centroid, Index="0", Wrap=True)
distance = Distance(PointA=area_3.Centroid, PointB=list_item_5)
number_slider_8 = Slider(31, range=0..100)
maximum = Maximum(A=distance, B=number_slider_8)
member_index = MemberIndex(Set=maximum, Member=number_slider_8)  # -> Index, Count
panel_3 = Panel(member_index.Index)
replace_items = ReplaceItems(List=height, Item="0", Indices=panel_3, Wrap=False)
panel_4 = Panel(replace_items)

unit_z = UnitZ(Factor=replace_items)
move_3 = Move(Geometry=rectangle.Rectangle, Motion=unit_z)  # -> Geometry, Transform
area_4 = Area(Geometry=move_3.Geometry)  # -> Area, Centroid
distance_2 = Distance(PointA=area.Centroid, PointB=area_4.Centroid)
bounds = Bounds(Numbers=distance_2)
box_rectangle = BoxRectangle(Rectangle=scale.Geometry, Height=distance_2)

# ----
# View
number_slider_9 = Slider(2, range=0..10)
viewpercent = LBViewPercent(
    view_type=Slider(1, range=0..10),
    geometry=flatten(brep_join.Breps),
    context=flatten([box_rectangle, boundary_surfaces]),
    grid_size=number_slider_9,
    offset_dist=Slider(0.1, range=0.1..1),
    parallel=Toggle(False),
    run=Toggle(True))  # -> report, points, view_vecs, results, mesh, legend, title, int_mtx; plug-in component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
mass_addition = MassAddition(Input=viewpercent.results)  # -> Result, PartialResults

remap_numbers = RemapNumbers(Value=distance_2, Source=bounds, Target=construct_domain)  # -> Mapped, Clipped

gradient = Gradient(
    LowerLimit=number_slider,
    UpperLimit=number_slider_2,
    Parameter=remap_numbers.Mapped,
    stops=[0: RGB(234, 38, 0), 0.25: RGB(234, 126, 0), 0.5: RGB(254, 244, 84), 0.75: RGB(173, 203, 249), 1: RGB(75, 107, 169)])
custom_preview = CustomPreview(Geometry=box_rectangle, Material=gradient)

panel_6 = Panel(mass_addition.Result)
