# Grasshopper definition tower_wind_ladybug.gh (Grasshopper 1.0.7)

number_slider = Slider(15, range=0..30)
number_slider_2 = Slider(5, range=0..10)
construct_domain = ConstructDomain(DomainStart=Slider(10, range=0..30), DomainEnd=Slider(30, range=0..30))
rectangular = Rectangular(Plane="0,0,0", SizeX=number_slider_2, SizeY=number_slider_2, ExtentX=number_slider, ExtentY=number_slider)  # -> Cells, Points
area = Area(Geometry=rectangular.Cells)  # -> Area, Centroid
bounding_box = BoundingBox(Content=flatten(rectangular.Cells), Plane=PlaneXY(0, 0, 0), UnionBox=True)  # -> Box, Box_2
polygon = Polygon(Plane=area.Centroid, Radius=Slider(1, range=0..10), Segments=Slider(4, range=0..10), FilletRadius=0)  # -> flatten(Polygon), Length
list_length = ListLength(List=polygon.Polygon)
random = Random(Range=construct_domain, Number=list_length, Seed=Slider(3, range=0..10))
unit_z = UnitZ(Factor=random)
multiplication = Multiplication(A=unit_z, B=Slider(0.829, range=0..1))
sort_list = SortList(Keys=polygon.Polygon, ValuesValuesA=multiplication)  # -> Keys, flatten(ValuesValuesA)
area_2 = Area(Geometry=polygon.Polygon)  # -> Area, Centroid
area_3 = Area(Geometry=bounding_box.Box)  # -> Area, Centroid
number_slider_3 = Slider(10, range=0..30)
distance = Distance(PointA=area_2.Centroid, PointB=area_3.Centroid)
maximum = Maximum(A=distance, B=number_slider_3)
construct_domain_2 = ConstructDomain(DomainStart=Slider(0, range=0..1), DomainEnd=Slider(1, range=0..1))

number_slider_4 = Slider(15, range=0..20)
ellipse = Ellipse(Plane=area_3.Centroid, Radius1=Slider(4, range=0..10), Radius2=Slider(6, range=0..10))  # -> Ellipse, Focus1, Focus2
series = Series(Start=0, Step=Slider(2, range=0..10), Count=number_slider_4)
pi = Pi(Factor=1)
unit_z_2 = UnitZ(Factor=series)
multiplication_2 = Multiplication(A=pi, B=Slider(0.26, range=0..1))
move = Move(Geometry=ellipse.Ellipse, Motion=unit_z_2)  # -> Geometry, Transform
series_2 = Series(Start=0, Step=multiplication_2, Count=number_slider_4)
area_4 = Area(Geometry=move.Geometry)  # -> Area, Centroid
graph_mapper = GraphMapper(
    series_2,
    x0=0,
    x1=10,
    y0=0,
    y1=1,
    container_name="Sine",
    Equation_px=[0.0008111483767, 0.3159206212],
    Equation_py=[0.4878938198, 0.9929964542])
scale = Scale(Geometry=move.Geometry, Center=area_4.Centroid, Factor=graph_mapper)  # -> Geometry, Transform
area_5 = Area(Geometry=scale.Geometry)  # -> Area, Centroid
series_3 = Series(Start=0, Step=Slider(19, range=0..100), Count=number_slider_4)
rotate = Rotate(Geometry=scale.Geometry, Angle=degrees(series_3), Plane=area_5.Centroid)  # -> Geometry, Transform
member_index = MemberIndex(Set=maximum, Member=number_slider_3)  # -> Index, Count
loft_options = LoftOptions(Closed=Toggle(True), Adjust=False, Rebuild=0, Refit=0, Type=Slider(2, range=0..3))
loft = Loft(Curves=rotate.Geometry, Options=loft_options)
custom_preview = CustomPreview(
    Geometry=loft,
    Material={diffuse=RGB(221, 160, 221), emission=RGB(66, 48, 66), shine=0.5, specular=RGB(255, 255, 255), transparency=0})

panel = Panel("http://climate.onebuilding.org/WMO_Region_5_Southwest_Pacific/MYS_Malaysia/JH_Johor/MYS_JH_Johor.AP.486790_TMYx.zip")
epwmap = LBEPWmap(epw_map=Toggle(True))  # -> Output; plug-in component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
downloadepw = LBDownloadWeather(weather_URL=panel)  # -> epw_file, stat_file, ddy_file; plug-in component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
importepw = LBImportEPW(epw_file=downloadepw.epw_file)  # -> location, dry_bulb_temperature, dew_point_temperature, relative_humidity, wind_speed, wind_direction, direct_normal_rad, diffuse_horizontal_rad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; plug-in component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
geometry = Geometry(loft)
analysisperiod = LBAnalysisPeriod(start_month=Slider(4, range=0..12), start_day=1, start_hour=0, end_month=Slider(10, range=0..12))  # -> period, hoys, dates; plug-in component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
windrose = LBWindRose(
    data=importepw.wind_speed,
    wind_direction=importepw.wind_direction,
    show_calmrose=Toggle(False),
    show_freq=Toggle(False),
    period=analysisperiod.period)  # -> out, mesh, compass, orient_line, freq_line, windrose_line, legend, title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; plug-in component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

replace_items = ReplaceItems(List=sort_list.ValuesValuesA, Item="0", Indices=member_index.Index, Wrap=False)
box_rectangle = BoxRectangle(Rectangle=polygon.Polygon, Height=replace_items)
bounds = Bounds(Numbers=replace_items)
remap_numbers = RemapNumbers(Value=replace_items, Source=bounds, Target=construct_domain_2)  # -> Mapped, Clipped
gradient = Gradient(
    LowerLimit=Slider(0.43, range=0..1),
    UpperLimit=Slider(1, range=0..1),
    Parameter=remap_numbers.Mapped,
    stops=[0: RGB(0, 128, 0), 0.5: RGB(255, 255, 0), 1: RGB(255, 0, 0)])
custom_preview_2 = CustomPreview(Geometry=box_rectangle, Material=gradient)
